# Dynamo graph dynamo-0-inputs-outputs.dyn (Dynamo 1.3.1.1736)

# group: .py file
file_path = Filename("D:\Dropbox\Bin\AU\files\external.py")

fromPath = FileObject(file_path)  # "File.FromPath"
readText = File.ReadText(fromPath)
python_script_from_string = PythonStringNode(script=readText)  # unwired: IN[0]
watch = Watch(python_script_from_string)
string = StringInput("Hello")
range = Range(lacing=Longest)
python_script = Python(IN[0]=string, IN[1]=range)  # starter script, not edited (OUT = 0)
watch_2 = Watch(python_script)
