# Dynamo graph example-dynamo-1-sort_points.dyn (Dynamo 1.3.1.1736)

# group: Solution
number_slider = DoubleSlider(55.8, range=0..100 step 0.1)
randomList = Math.RandomList(number_slider)
randomList_2 = Math.RandomList(number_slider)
byCoordinates = Point.ByCoordinates(x=randomList, y=randomList_2)
python_script = Python(IN[0]=byCoordinates)
# ---------- python_script.python (16 lines) ----------
import clr  # Imports Ironpython's Common Language Runtime module
clr.AddReference('ProtoGeometry')  # Imports DesignScript Dll Assembly
from Autodesk.DesignScript.Geometry import Vector  # Import the Vector Class

random_points = IN[0]  # Assigns random point to a variable
origin = IN[1]  # Assigns Origin to a variable

distance_and_points = []  # Create an empty list to hold our new list
for point in random_points:  # Iterate through each point 
    vector = Vector.ByTwoPoints(origin, point)  # Create  vector from PT to origin
    distance = vector.Length  # store vector's length in a variable 
    group = [distance, point]  # Create a new sublist with distance and the point
    distance_and_points.append(group)  # append the sublist to our main list
    
sorted_points = sorted(distance_and_points)  # Sort the nested list
OUT = sorted_points  # Output sorted list
# ----------------------------------------
integer_slider = IntegerSlider(0, range=0..100 step 1)
getItemAtIndex = List.GetItemAtIndex(list=python_script, index=integer_slider)
watch = Watch(python_script)

integer_slider_2 = IntegerSlider(100, range=0..100 step 1)
randomList_3 = Math.RandomList(integer_slider_2)
randomList_4 = Math.RandomList(integer_slider_2)
# note: Random Point Sample
byCoordinates_2 = Point.ByCoordinates(x=randomList_3, y=randomList_4)
# note: Origin (0,0)
byCoordinates_3 = Point.ByCoordinates()
python_script_2 = Python(IN[0]=byCoordinates_2, IN[1]=byCoordinates_3)
# ---------- python_script_2.python (5 lines) ----------
import ___
clr.AddReference('______')
from Autodesk.DesignScript.Geometry import ______
random_points = ___
origin = ___
# ----------------------------------------
