# Dynamo graph example-dynamo-2-sheet-number.dyn (Dynamo 1.3.1.1736)

# group: Solution
categories = Categories("Sheets")
all_elements_of_category = ElementsOfCategory(categories)
python_script = Python(IN[0]=all_elements_of_category)
# ---------- python_script.python (14 lines) ----------
import re  # Imports the Regular Expression Module

sheets = IN[0]  # Assigns the Input IN[0] to the variable `sheets`
pattern = '[A-Z]-\d-\d{4}'  # Creates a regular expression pattern, explained below
bad_sheets = []  # Creates an empty list. We will use this to store sheets
# Iterates through all sheets.
for sheet in sheets:
    sheet_number= sheet.SheetNumber  # Get sheet name and assign to variable
    # re.search takes a pattern, and a sheet name as arguments
    match = re.search(pattern , sheet_number)
    # if a match is not found, match will be None, else it will return the match
    if not match:
        bad_sheets.append(sheet)
OUT = bad_sheets
# ----------------------------------------
watch = Watch(python_script)
name = Element.Name(watch)
watch_2 = Watch(name)

# note: Select Sheets that match the pattern X-1-0001
categories_2 = Categories("Sheets")
all_elements_of_category_2 = ElementsOfCategory(categories_2)
python_script_2 = Python(IN[0]=all_elements_of_category_2)
# ---------- python_script_2.python (6 lines) ----------
import re

sheets = IN[0]

pattern = '[A-Z]-\d-\d{4}'
bad_names = []
# ----------------------------------------
name_2 = Element.Name(python_script_2)
watch_3 = Watch(name_2)
watch_4 = Watch(all_elements_of_category_2)
