# Dynamo graph example-dynamo-3-door-mirrored.dyn (Dynamo 1.3.1.1736)

# note: Select Mirrored Doors
python_script = Python()  # unwired: IN[0]
# ---------- python_script.python (23 lines) ----------
import clr
# Import RevitAPI Dll Assembly Classes
clr.AddReference("RevitAPI")
from Autodesk.Revit.DB import FilteredElementCollector, BuiltInCategory

# Import DocumentManager and TransactionManager
clr.AddReference("RevitServices")
from RevitServices.Transactions import TransactionManager
from RevitServices.Persistence import DocumentManager
# Create variable for Revit Document
doc = DocumentManager.Instance.CurrentDBDocument

# Start Transaction
TransactionManager.Instance.EnsureInTransaction(doc)


#############
# CODE HERE #
#############


# End Transaction
TransactionManager.Instance.TransactionTaskDone()
# ----------------------------------------
watch = Watch(python_script)

# group: Solutions
python_script_2 = Python()  # unwired: IN[0]
# ---------- python_script_2.python (29 lines) ----------
import clr
# Import RevitAPI Dll Assembly Classes
clr.AddReference("RevitAPI")
from Autodesk.Revit.DB import FilteredElementCollector, BuiltInCategory

# Import DocumentManager and TransactionManager
clr.AddReference("RevitServices")
from RevitServices.Transactions import TransactionManager
from RevitServices.Persistence import DocumentManager
# Create variable for Revit Document
doc = DocumentManager.Instance.CurrentDBDocument

# Start Transaction
TransactionManager.Instance.EnsureInTransaction(doc)

collector = FilteredElementCollector(doc)
doors = collector.OfCategory(BuiltInCategory.OST_Doors).WhereElementIsNotElementType()

OUT = []

for door in doors:
	if door.Mirrored:
		comment_param = door.LookupParameter('Comments')
		# returns a parameter object
		comment_param.Set('Is Mirrored')
		OUT.append(door)

# End Transaction
TransactionManager.Instance.TransactionTaskDone()
# ----------------------------------------
watch_2 = Watch(python_script_2)
