# Dynamo graph misc-unwrap.dyn (Dynamo 1.3.1.1736)

code_block = CodeBlock { "OUT = IN[0]"; "OUT = UnwrapElement(IN[0])"; }
views = Views("1ST FLOOR")
python_script_from_string = PythonStringNode(script=code_block.out0, IN[0]=views)
watch = Watch(python_script_from_string)
python_script_from_string_2 = PythonStringNode(script=code_block.out1, IN[0]=views)
watch_2 = Watch(python_script_from_string_2)
code_block_2 = CodeBlock { "OUT = IN[0].__class__.__doc__"; "OUT = UnwrapElement(IN[0]).__class__.__doc__"; }
views_2 = Views("1ST FLOOR")
python_script_from_string_3 = PythonStringNode(script=code_block_2.out1, IN[0]=views_2)

# group: Revit API
watch_3 = Watch(python_script_from_string_3)

python_script_from_string_4 = PythonStringNode(script=code_block_2.out0, IN[0]=views_2)

# group: Dynamo
watch_4 = Watch(python_script_from_string_4)

code_block_3 = CodeBlock()
# ---------- code_block_3.designscript (11 lines) ----------
"
import clr
clr.AddReference('RevitNodes')
import Revit
# Adds ToDSType (bool) extension method to Wrapped elements
clr.ImportExtensions(Revit.Elements)
# Adds ToProtoType, ToRevitType geometry conversion extension methods to objects
clr.ImportExtensions(Revit.GeometryConversion)

OUT = UnwrapElement(IN[0]).ToDSType(1).__class__.__doc__
";
# ----------------------------------------
views_3 = Views("1ST FLOOR")
python_script_from_string_5 = PythonStringNode(script=code_block_3, IN[0]=views_3)
watch_5 = Watch(python_script_from_string_5)
